# Requirement set Installation Tool Requirements (R2019b)

## 1 [L-FUNC-040] The motor shall be able to apply at least 3.62Nm
Functional

## 2 [L-FUNC-050] The controller shall account for actuator limits

## 3 [L-FUNC-060] The controller shall maintain the output torque at the stress midpoint with at least 6dB Gain Margin

## 4 [L-FUNC-070] The sensor shall provide optical RPM Measurements

## 5 [L-FUNC-080] A debounce mechanism shall be implemented for the encoder output