% Requirement links of ToolSimscape.slx (R2019b)

model implements Installation Tool Requirements.slreqx#5: The controller shall maintain the output torque at the stress midpoint with at least 6dB Gain Margin
block :22 implements Installation Tool Requirements.slreqx#1: The tool shall provide a motorised solution
block :26 implements Installation Tool Requirements.slreqx#6: The tool shall control the torque applied to the motor
block :26 implements Installation Tool Requirements.slreqx#2: 1.1: The controller shall account for actuator limits
block :26 implements Installation Tool Requirements.slreqx#5: The controller shall maintain the output torque at the stress midpoint with at least 6dB Gain Margin
block :29 implements Installation Tool Requirements.slreqx#2: The tool shall provide RPM measurements
block :29 implements Installation Tool Requirements.slreqx#6: 4: The sensor shall provide optical RPM Measurements
block :35 implements Installation Tool Requirements.slreqx#2: 1.1: The controller shall account for actuator limits
block :36 implements Installation Tool Requirements.slreqx#7: 5: A debounce mechanism shall be implemented for the encoder output